# Dynamo graph GetVolumes.dyn (Dynamo 1.3.4.6666)

string = StringInput("C:\Users\Marat\Documents\Thesis\BackendServer\InnerSurface.obj")
categories = Categories("Rooms")
all_elements_of_category = ElementsOfCategory(categories)
solids = Element.Solids(all_elements_of_category)
flatten = Flatten(solids)
number = DoubleInput(9)
number_2 = DoubleInput(11)
range = Range(start=number, end=number_2, lacing=Longest)
getItemAtIndex = List.GetItemAtIndex(list=flatten, index=range)
watch = Watch(getItemAtIndex)
number_3 = DoubleInput(0)
number_4 = DoubleInput(1)
range_2 = Range(start=number_3, end=number_4, lacing=Longest)
getItemAtIndex_2 = List.GetItemAtIndex(list=flatten, index=range_2)
watch_2 = Watch(getItemAtIndex_2)
addItemToEnd = List.AddItemToEnd(item=watch, list=watch_2)
flatten_2 = Flatten(addItemToEnd)
watch_3 = Watch(flatten_2)
byUnion = Solid.ByUnion(watch_3)
byGeometry = Autodesk.Dynamo.MeshToolkit.Mesh.ByGeometry(byUnion)
exportMeshes = Autodesk.Dynamo.MeshToolkit.Mesh.ExportMeshes(string, byGeometry)
